# Grasshopper definition owf-polyline-methods.gh (Grasshopper 1.0.8)
# plug-ins: Ovenbird 2

examplefiles = ExampleFiles()
crv = Curve(<curve referenced from the Rhino model>)
wraptp = WrapToolpath(Curve=crv, eachBranchIsToolpath=False, postProcessResolution=0, postProcessType=-1, sortGroups=True, useReference=0)
polylinetp = PolylineToolpath(Toolpath=wraptp, polylineType=0)
